# Grasshopper definition Organic_Voronoi_Panel - Adam Parametric.gh (Grasshopper 1.0.8)

# @AdamArchh
X = Slider(500, range=0..1000)
Y = Slider(350, range=0..1000)
V = Slider(1.35, range=0..5)
xz = XZPlane(Origin=Point(0, 0, 0))
planesrf = PlaneSurface(Plane=xz, XSize=X, YSize=Y)
neg = Negative(Value=V)
offset = OffsetCurve(Curve=planesrf, Distance=neg, Corners=1)
pop2d = Populate2D(Region=offset, Count=Slider(100, range=0..100), Seed=Slider(14, range=0..50))
number_slider = Slider(12, range=3..12)
voronoi = Voronoi(Points=pop2d, Boundary=offset, BruteForceOverride=False)
offset_2 = OffsetCurve(Curve=voronoi, Distance=neg, Corners=1)
expression = Expression(x=number_slider, Expression="x-1")
divide = DivideCurve(Curve=offset_2, Count=number_slider, Kinks=False)  # -> Points, Tangents, Parameters
nurbs = NurbsCurve(Vertices=divide.Points, Degree=expression, Periodic=invert(False))  # -> Curve, Length, Domain
boundary = BoundarySurfaces(Edges=flatten([planesrf, nurbs.Curve]))
planar = IsPlanar(Surface=boundary, Interior=True)  # -> Planar, Plane
amp = Amplitude(Vector=planar.Plane, Amplitude=Slider(3.5, range=0..10))
extr = Extrude(Base=boundary, Direction=amp)
brep = Brep(extr)
