# Grasshopper definition POLYGONING.gh (Grasshopper 1.0.8)
# plug-ins: Parakeet, Flexibility

srf = Surface(<surface referenced from the Rhino model>)
number_slider = Slider(0.8, range=0..1)
number_slider_2 = Slider(40, range=0..100)
number_slider_3 = Slider(49, range=0..100)
scale_nu = ScaleNU(Geometry=srf, Plane=PlaneXY(0, 0, 0), ScaleX=number_slider, ScaleY=number_slider, ScaleZ=1)  # -> Geometry, Transform
sdivide = DivideSurface(Surface=srf, UCount=number_slider_3, VCount=number_slider_2)  # -> Points, Normals, Parameters
sdivide_2 = DivideSurface(Surface=scale_nu.Geometry, UCount=number_slider_3, VCount=number_slider_2)  # -> Points, Normals, Parameters
quad_panel = QuadPanel(Points=flatten(sdivide.Points), U=number_slider_3, V=number_slider_2)  # -> Curves, Center, Surface
quad_panel_2 = QuadPanel(Points=flatten(sdivide_2.Points), U=number_slider_3, V=number_slider_2)  # -> Curves, Center, Surface
num = Number(number_slider_2)
expression = Expression(x=num, Expression="X-1")  # disabled

number_slider_4 = Slider(2, range=0..3)  # disabled
number_slider_5 = Slider(0, range=0..3)  # disabled
debrep = DeconstructBrep(Brep=graft(quad_panel_2.Surface))  # -> Faces, simplify(Edges), Vertices; disabled
item = ListItem(List=debrep.Edges, Index=number_slider_4, Wrap=True)  # -> simplify(flatten(Item)); disabled
item_2 = ListItem(List=debrep.Edges, Index=number_slider_5, Wrap=True)  # -> simplify(flatten(Item)); disabled
number_slider_6 = Slider(0, range=0..9)  # disabled
partition = PartitionList(List=item, Size=num)  # disabled
partition_2 = PartitionList(List=item_2, Size=num)  # disabled
item_3 = ListItem(List=partition, Index=expression, Wrap=True)  # -> flatten(Item); disabled
item_4 = ListItem(List=partition_2, Index=number_slider_6, Wrap=True)  # -> flatten(Item); disabled

join = BrepJoin(Breps=quad_panel_2.Surface)  # -> Breps, Closed; disabled
expression_2 = Expression(x=num, Expression="X-1")

debrep_2 = DeconstructBrep(Brep=graft(quad_panel.Surface))  # -> Faces, simplify(Edges), Vertices
item_5 = ListItem(List=debrep_2.Edges, Index=Slider(2, range=0..3), Wrap=True)  # -> simplify(flatten(Item))
item_6 = ListItem(List=debrep_2.Edges, Index=Slider(0, range=0..3), Wrap=True)  # -> simplify(flatten(Item))
partition_3 = PartitionList(List=item_5, Size=num)
partition_4 = PartitionList(List=item_6, Size=num)
item_7 = ListItem(List=partition_3, Index=expression_2, Wrap=True)  # -> flatten(Item)
item_8 = ListItem(List=partition_4, Index=Slider(0, range=0..9), Wrap=True)  # -> flatten(Item)

join_2 = BrepJoin(Breps=quad_panel.Surface)  # -> Breps, Closed
join_3 = JoinCurves(Curves=item_3, Preserve=False)  # disabled
join_4 = JoinCurves(Curves=item_4, Preserve=False)  # disabled
join_5 = JoinCurves(Curves=item_8, Preserve=False)  # disabled
join_6 = JoinCurves(Curves=item_7, Preserve=False)
boundary = BoundarySurfaces(Edges=item_8)
boundary_2 = BoundarySurfaces(Edges=[join_4, join_5])  # disabled
patch = Patch(Curves=join_6, Spans=Slider(10, range=0..10), Flexibility=Slider(10, range=0..10), Trim=True)
createsolid = CreateSolid(Breps=[join_2.Breps, boundary, patch])
