# Grasshopper definition ShieldsPattern.gh (Grasshopper 1.0.8)

pt = Point([Point(0, 0, 6), Point(-3.464101615, 0, 0), Point(3.464101615, 0, 0)])
pline = PolyLine(Vertices=pt, Closed=True)
boundary = BoundarySurfaces(Edges=pline)
debrep = DeconstructBrep(Brep=boundary)  # -> Faces, Edges, Vertices
item = ListItem(List=debrep.Edges, Index=0, Wrap=True)  # -> Item, Item1
item_2 = ListItem(List=debrep.Vertices, Index=0, Wrap=True)  # -> Item, Item1, Item2
Z = UnitZ(Factor=Slider(1.2, range=1..10))
midpt = CurveMiddle(Curve=item.Item1)
rev = Reverse(Vector=Z)
Y = UnitY(Factor=Slider(0.6, range=0..1))
move = Move(Geometry=midpt, Motion=rev)  # -> Geometry, Transform
rev_2 = Reverse(Vector=Y)
move_2 = Move(Geometry=[item_2.Item, move.Geometry], Motion=rev_2)  # -> Geometry, Transform
item_3 = ListItem(List=debrep.Vertices, Index=0, Wrap=True)  # -> Item, Item1, Item2
item_4 = ListItem(List=move_2.Geometry, Index=0, Wrap=True)  # -> Item, Item1
srf4pt = _4PointSurface(CornerA=item_3.Item2, CornerB=item_4.Item, CornerC=item_4.Item1)
srf4pt_2 = _4PointSurface(CornerA=item_4.Item, CornerB=item_3.Item1, CornerC=item_4.Item1)
pt_2 = Point(item_3.Item)
pt_3 = Point(item_3.Item2)
join = BrepJoin(Breps=[srf4pt, srf4pt_2])  # -> Breps, Closed
Y_2 = UnitY(Factor=Slider(1, range=1..10))
extr = Extrude(Base=join.Breps, Direction=Y_2)
pt_4 = Point(item_3.Item)
mirror = Mirror(Geometry=extr, Plane=pt_4)  # -> Geometry, Transform
vec2pt = Vector2Pt(PointA=pt_2, PointB=pt_3, Unitize=False)  # -> Vector, Length
pt_5 = Point(item_4.Item)
pt_6 = Point(item_4.Item1)
move_3 = Move(Geometry=mirror.Geometry, Motion=vec2pt.Vector)  # -> Geometry, Transform
vec2pt_2 = Vector2Pt(PointA=pt_5, PointB=pt_6, Unitize=False)  # -> Vector, Length
rev_3 = Reverse(Vector=vec2pt_2.Vector)
series = Series(Start=0, Step=1, Count=Slider(10, range=0..10))
multiplication = Multiplication(A=rev_3, B=series)
pt_7 = Point(item_3.Item1)
pt_8 = Point(item_3.Item2)
move_4 = Move(Geometry=extr, Motion=multiplication)  # -> Geometry, Transform
move_5 = Move(Geometry=move_3.Geometry, Motion=multiplication)  # -> Geometry, Transform
group = Group(Geometry=move_5.Geometry)
group_2 = Group(Geometry=move_4.Geometry)
vec2pt_3 = Vector2Pt(PointA=pt_7, PointB=pt_8, Unitize=False)  # -> Vector, Length
group_3 = Group(Geometry=[group, group_2])
series_2 = Series(Start=0, Step=1, Count=Slider(18, range=0..100))
multiplication_2 = Multiplication(A=vec2pt_3.Vector, B=series_2)
move_6 = Move(Geometry=group_3, Motion=multiplication_2)  # -> Geometry, Transform
ungroup = Ungroup(Group=move_6.Geometry)
item_5 = ListItem(List=ungroup, Index=0, Wrap=True)  # -> Item, Item1
ungroup_2 = Ungroup(Group=item_5.Item)
ungroup_3 = Ungroup(Group=item_5.Item1)
brep = Brep(ungroup_2)
brep_2 = Brep(ungroup_3)
wires = BrepWireframe(Brep=brep_2, Density=-1)
wires_2 = BrepWireframe(Brep=brep, Density=-1)
swatch = ColourSwatch(SwatchColor=RGB(0, 0, 0))
preview = CustomPreview(Geometry=brep, Material=ColourSwatch(SwatchColor=RGB(204, 202, 202)))
preview_2 = CustomPreview(Geometry=wires_2, Material=swatch)
preview_3 = CustomPreview(Geometry=brep_2, Material=ColourSwatch(SwatchColor=RGB(252, 109, 109)))
preview_4 = CustomPreview(Geometry=wires, Material=swatch)
