# Grasshopper definition Voronoi 3D - 3D Beast.gh (Grasshopper 1.0.8)
# plug-ins: Weaverbird

brep = Brep(<brep referenced from the Rhino model>)
bbox = BoundingBox(Content=brep, Plane=PlaneXY(0, 0, 0))  # -> Box, Box_2
volume = Volume(Geometry=bbox.Box)  # -> Volume, Centroid
brep_2 = Brep(<brep referenced from the Rhino model>)
scale = Scale(Geometry=bbox.Box, Center=volume.Centroid, Factor=Slider(1.12, range=1..2))  # -> Geometry, Transform
popgeo = PopulateGeometry(Geometry=brep, Count=Slider(329, range=0..500), Seed=1)
pop3d = Populate3D(Region=scale.Geometry, Count=Slider(1000, range=0..1000), Seed=1, Points=popgeo)
merge = Merge(Data1=pop3d, Data2=popgeo)  # -> flatten(Result)
brepinc = PointInBrep(Brep=brep, Point=merge, Strict=False)
panel = Panel(brepinc)
cull = CullPattern(List=merge, CullPattern=brepinc)
voronoi³ = Voronoi3D(Points=cull, Box=scale.Geometry)  # -> Cells, Boundary
sint = SolidIntersection(BrepsA=graft(voronoi³.Cells), BrepsB=brep)
edges = BrepEdges(Brep=sint)  # -> Naked, simplify(flatten(Interior)), NonManifold
edges_2 = BrepEdges(Brep=brep)  # -> Naked, Interior, NonManifold
midpt = CurveMiddle(Curve=edges.Interior)
crv = Curve(edges_2.Interior)
pull = PullPoint(Point=midpt, Geometry=crv, ClosestOnly=True)  # -> ClosestPoint, Distance, Index
smaller = SmallerThan(FirstNumber=pull.Distance, SecondNumber=Slider(0.06, range=0..0.1))  # -> SmallerThan, OrEqualTo
cull_2 = CullPattern(List=edges.Interior, CullPattern=invert(smaller.SmallerThan))
end = EndPoints(Curve=cull_2)  # -> Start, End
ln = Line(StartPoint=end.Start, EndPoint=end.End)
dupln = RemoveDuplicateLines(Lines=ln, Tolerance=0.01)
cp = ControlPoints(Curve=dupln)  # -> Points, Weights, Knots
flatten = FlattenTree(Tree=cp.Points, Path="{0}")
pgroups = PointGroups(Points=flatten, Distance=Slider(1, range=0..1))  # -> Groups, Indices
avr = Average(Input=pgroups.Groups)
lng = ListLength(List=pgroups.Groups)
dup = DuplicateData(Data=avr, Number=lng, Order=True)  # -> flatten(Data)
replace = ReplaceItems(List=flatten, Item=dup, Indices=flatten(pgroups.Indices), Wrap=False)
unflatten = UnflattenTree(Tree=replace, Guide=cp.Points)  # -> simplify(Tree)
pline = PolyLine(Vertices=unflatten, Closed=False)
viewer = ParamViewer(unflatten)
mp = MultiPipe(
    Curves=flatten(pline),
    NodeSize=Slider(2, range=0..5),
    EndOffset=1,
    StrutSize=Slider(1, range=0..10),
    Segment=0,
    KinkAngle=0.6,
    CubeFit=0,
    Caps=0)
mesh = Mesh(mp)
preview = CustomPreview(
    Geometry=mp,
    Material={diffuse=RGB(221, 160, 221), emission=RGB(66, 48, 66), shine=0.5, specular=RGB(255, 255, 255), transparency=0})
wbcatmullclark = WeaverbirdsCatmullClarkSubdivision(MeshCurves=mesh, Level=Slider(2, range=0..10), SmoothNakedEdges=1)
wblaplace = WeaverbirdsLaplacianSmoothing(MeshCurves=wbcatmullclark, Level=Slider(3, range=0..10), SmoothNakedEdges=1, Thin=1)
preview_2 = CustomPreview(
    Geometry=wblaplace,
    Material={diffuse=RGB(221, 160, 221), emission=RGB(66, 48, 66), shine=0.5, specular=RGB(255, 255, 255), transparency=0})
