# Grasshopper definition VoronoiDesigns.gh (Grasshopper 1.0.8)
# plug-ins: Weaverbird

srf = Surface(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)
bbox = BoundingBox(Content=srf, Plane=PlaneXY(0, 0, 0))  # -> Box, Box_2
popgeo = PopulateGeometry(Geometry=srf, Count=Slider(135, range=0..1000), Seed=1)
volume = Volume(Geometry=bbox.Box)  # -> Volume, Centroid
scale = Scale(Geometry=bbox.Box, Center=volume.Centroid, Factor=Slider(1.1, range=0..10))  # -> Geometry, Transform
voronoi³ = Voronoi3D(Points=popgeo, Box=scale.Geometry)  # -> Cells, Boundary
bbx = BrepBrep(BrepA=srf, BrepB=voronoi³.Cells)  # -> Curves, Points
disc = Discontinuity(Curve=bbx.Curves, Level=1)  # -> Points, Parameters
avr = Average(Input=disc.Points)
scale_2 = Scale(Geometry=disc.Points, Center=avr, Factor=Slider(0.6, range=0..1))  # -> Geometry, Transform
pline = PolyLine(Vertices=scale_2.Geometry, Closed=True)
srfsplit = SurfaceSplit(Surface=srf, Curves=flatten(pline))
item = ListItem(List=srfsplit, Index=0, Wrap=True)
area = Area(Geometry=srfsplit)  # -> Area, Centroid
mesh = MeshBrep(
    Brep=item,
    Settings={GridMaxCount=0, GridMinCount=16, JaggedSeams=False, MaxEdgeLength=0, MinEdgeLength=0.0001, MinTolerance=0, Refine=True, RefineAngle=0, RelativeTolerance=0.65, SimplePlanes=True, Tolerance=0})
wbthicken = WeaverbirdsMeshThicken(MeshCurves=mesh, Distance=Slider(4.2, range=0..10), OffsetType=0)
wbcatmullclark = WeaverbirdsCatmullClarkSubdivision(MeshCurves=wbthicken, Level=1, SmoothNakedEdges=1)
preview = CustomPreview(Geometry=wbcatmullclark, Material=ColourSwatch(SwatchColor=RGB(255, 255, 255)))
