# Grasshopper definition test.gh (Grasshopper 1.0.8)
# Copyright: ©2019 GNU General Public License
# plug-ins: Parakeet, Weaverbird, Shortest Walk in Gh, DendroGH, Flexibility

number_slider = Slider(237, range=0..1000)  # disabled
brep = Brep(<brep referenced from the Rhino model>)
brep_2 = Brep(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)
explode = ExplodeObject(Object=brep_2, Recursive=False)
number_slider_2 = Slider(1212, range=0..10000)  # disabled
number_slider_3 = Slider(0.1, range=0..1)  # disabled
brep_3 = Brep(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)
number_slider_4 = Slider(1, range=0..1)  # disabled
number_slider_5 = Slider(6, range=0..10)  # disabled
number_slider_6 = Slider(3, range=0..6)  # disabled
number_slider_7 = Slider(100, range=0..100)  # disabled
number_slider_8 = Slider(2, range=0..100)  # disabled
number_slider_9 = Slider(0, range=0..100)  # disabled
number_slider_10 = Slider(0.7, range=0..10)  # disabled
xz = XZPlane(Origin=Point(0, 0, 0))  # disabled
number_slider_11 = Slider(6.9, range=0..50)  # disabled
vf = CrystallonV2VoronoiFill(geometry=brep, number_of_points=number_slider, use_attractor=False, enable_voronoi=True)  # -> voronoi_lattice, voronoi_lattice_skin, preview_points; disabled
pop3d = Populate3D(Region=brep, Count=number_slider, Seed=1)  # disabled
mesh = MeshBrep(
    Brep=brep_3,
    Settings={GridMaxCount=0, GridMinCount=16, JaggedSeams=False, MaxEdgeLength=0, MinEdgeLength=0.0001, MinTolerance=0, Refine=True, RefineAngle=0, RelativeTolerance=0.65, SimplePlanes=True, Tolerance=0})  # disabled
multiplication = Multiplication(A=number_slider_5, B=number_slider_8)  # disabled
number_slider_12 = Slider(0, range=0..100)  # disabled
populatemesh_fast = PopulateMesh(Mesh=mesh, Count=number_slider_2, Seed=1, Method=5)  # disabled
number_slider_13 = Slider(20, range=0..100)
vsettings = CreateSettings(VoxelSize=number_slider_10, Bandwidth=number_slider_6, Isovalue=0, Adaptivity=number_slider_4)  # disabled
number_slider_14 = Slider(10, range=0..100)  # disabled
number_slider_15 = Slider(9, range=0..100)  # disabled
item = ListItem(List=explode, Index=Slider(1, range=0..5), Wrap=True)
item_2 = ListItem(List=explode, Index=Slider(2, range=0..5), Wrap=True)
vsettings_2 = CreateSettings(VoxelSize=number_slider_8, Bandwidth=number_slider_7, Isovalue=0, Adaptivity=0.1)  # disabled
popgeo = PopulateGeometry(Geometry=brep_2, Count=Slider(1000, range=0..1000), Seed=Slider(50, range=0..100))
penrose = Penrose(Plane=xz, Size=number_slider_3, Iteration=number_slider_9)  # disabled
patterngenb = PatternGenotypeB(Factor=0.5)  # disabled
area = Area(Geometry=item_2)  # -> Area, Centroid
vpoints = PointsToVolume(Points=pop3d, PointRadius=multiplication, Settings=vsettings_2)  # disabled
area_2 = Area(Geometry=item)  # -> Area, Centroid
vcurve = CurveToVolume(Curves=vf.voronoi_lattice, CurveRadius=number_slider_11, Settings=vsettings)  # disabled
number_slider_16 = Slider(3, range=0..10)  # disabled
number_slider_17 = Slider(70, range=0..100)
prox = Proximity3D(Points=populatemesh_fast, Group=number_slider_14, MinRadius=number_slider_12, MaxRadius=number_slider_15)  # -> flatten(Links), Topology; disabled
cir = Circle(Plane=area.Centroid, Radius=Slider(8.75, range=0..100))
mesh_2 = Mesh(vpoints)  # disabled
mesh_3 = Mesh(vcurve)  # disabled
htilinga = HyperbolicTilingA(Plane=PlaneXY(0, 0, 0), P=4, Q=5, RotatationFactor=0, OriginShift=0, RotateOriginPoint=0, Scale=10, Step=4)  # -> CurvedPolygons, LinearPolygons; disabled
cir_2 = Circle(Plane=area_2.Centroid, Radius=Slider(8.5, range=0..100))
wbblur = WeaverbirdsBlurMesh(MeshCurves=mesh_3, Level=1, Thin=1)  # disabled
swatch = ColourSwatch(SwatchColor=RGB(90, 184, 179))  # disabled
removedupcrvs = RemoveDuplicateCurves(Curves=prox.Links, FastF=True)  # disabled
wbcatmullclark = WeaverbirdsCatmullClarkSubdivision(MeshCurves=mesh_2, Level=number_slider_16, SmoothNakedEdges=1)  # disabled
len = Length(Curve=prox.Links)  # -> simplify(flatten(Length)); disabled
wbcatmullclark_2 = WeaverbirdsCatmullClarkSubdivision(MeshCurves=mesh_3, Level=1, SmoothNakedEdges=1)  # disabled
number_slider_18 = Slider(0.7, range=0..1)  # disabled
divide = DivideCurve(Curve=cir_2, Count=number_slider_17, Kinks=False)  # -> Points, Tangents, Parameters
number_slider_19 = Slider(1.12, range=0..10)  # disabled
divide_2 = DivideCurve(Curve=cir, Count=number_slider_17, Kinks=False)  # -> Points, Tangents, Parameters
smaller = SmallerThan(FirstNumber=len, SecondNumber=0)  # -> SmallerThan, OrEqualTo; disabled
preview = CustomPreview(Geometry=wbcatmullclark, Material=swatch)  # disabled
preview_2 = CustomPreview(
    Geometry=wbcatmullclark_2,
    Material={diffuse=RGB(221, 160, 221), emission=RGB(66, 48, 66), shine=0.5, specular=RGB(255, 255, 255), transparency=0})  # disabled
points = PointList(Points=divide.Points)
points_2 = PointList(Points=divide_2.Points)
vsettings_3 = CreateSettings(VoxelSize=number_slider_18, Bandwidth=1, Isovalue=0, Adaptivity=0.1)  # disabled
ln = Line(StartPoint=divide.Points, EndPoint=divide_2.Points)
prox_2 = Proximity3D(
    Points=flatten(popgeo),
    Group=Slider(3, range=0..10),
    MinRadius=Slider(3, range=0..100),
    MaxRadius=Slider(100, range=0..100))  # -> flatten(Links), Topology
vcurve_2 = CurveToVolume(Curves=prox.Links, CurveRadius=number_slider_19, Settings=vsettings_3)  # disabled
number_slider_20 = Slider(27, range=0..100)
dupln = RemoveDuplicateLines(Lines=prox_2.Links, Tolerance=0.01)
number_slider_21 = Slider(4, range=0..10)  # disabled
mvolume = VolumeToMesh(Volume=vcurve_2, VolumeSettings=vsettings_3)  # disabled
wblaplace = WeaverbirdsLaplacianSmoothing(MeshCurves=mvolume, Level=number_slider_21, SmoothNakedEdges=1, Thin=1)  # disabled
shortwalk = ShortestWalk(Curves=dupln, WantedPath=ln)  # -> ShortestWalk, Succession, Direction, Length
swatch_2 = ColourSwatch(SwatchColor=RGB(185, 237, 183))  # disabled
explode_2 = Explode(Curve=shortwalk.ShortestWalk, Recursive=True)  # -> flatten(Segments), Vertices
preview_3 = CustomPreview(Geometry=wblaplace, Material=swatch_2)  # disabled
dupln_2 = RemoveDuplicateLines(Lines=explode_2.Segments, Tolerance=0.01)
vsettings_4 = CreateSettings(VoxelSize=Slider(0.5, range=0..1), Bandwidth=Slider(20, range=0..100), Isovalue=0, Adaptivity=0.1)
vcurve_3 = CurveToVolume(Curves=dupln_2, CurveRadius=Slider(1, range=0..10), Settings=vsettings_4)
vsettings_5 = CreateSettings(VoxelSize=1, Bandwidth=1, Isovalue=0, Adaptivity=0.1)
preview_4 = CustomPreview(
    Geometry=vcurve_3,
    Material={diffuse=RGB(221, 160, 221), emission=RGB(66, 48, 66), shine=0.5, specular=RGB(255, 255, 255), transparency=0})
mp = MultiPipe(NodeSize=0.5, EndOffset=1, StrutSize=1, Segment=0, KinkAngle=0.6, CubeFit=0, Caps=0)
mvolume_2 = VolumeToMesh(Volume=vcurve_3, VolumeSettings=vsettings_5)
wbcatmullclark_3 = WeaverbirdsCatmullClarkSubdivision(MeshCurves=mvolume_2, Level=1, SmoothNakedEdges=1)

# ==== cluster CrystallonV2VoronoiFill: Fill a volume with randomized voronoi cells

geometry = ClusterInput()  # Geometry to fill
number_of_points = ClusterInput()  # The initial number of random points to fill the volume
use_attractor = ClusterInput()  # If true, points will be filtered by distance to attractor(s)
attractor = ClusterInput()  # Any geometry to use as attractor(s)
magnitude_of_random_filtering = ClusterInput()  # Magnitude of random filtering
number_of_filtered_points = ClusterInput()  # The number of points to filter
enable_voronoi = ClusterInput()  # If true, voronoi cells will be generated (can be very slow)
geo = Geometry(geometry)
geo_2 = Geometry(attractor)
# CRYSTALLON V2.0 -- Lattice structure tools for Grasshopper3D
# 
# Copyright (C) 2019  Aaron Porterfield
# 
# www.fequalsf.com
# info@fequalsf.com
# 
#     This program is free software: you can redistribute it and/or modify
#     it under the terms of the GNU General Public License as published by
#     the Free Software Foundation, either version 3 of the License, or any later version.
# 
#     This program is distributed in the hope that it will be useful,
#     but WITHOUT ANY WARRANTY; without even the implied warranty of
#     MERCHANTABILITY or FITNESS FOR A PARTICULAR PURPOSE.  See the
#     GNU General Public License for more details.
# 
#     You should have received a copy of the GNU General Public License
#     along with this program.  If not, see <http://www.gnu.org/licenses/>.
mesh = Mesh(geo)
bbox = BoundingBox(Content=mesh, Plane=PlaneXY(0, 0, 0))  # -> Box, Box_2
pop3d = Populate3D(Region=bbox.Box, Count=number_of_points, Seed=1)
dom = ConstructDomain(DomainStart=expr("x*-1", magnitude_of_random_filtering), DomainEnd=magnitude_of_random_filtering)
pull = PullPoint(Point=pop3d, Geometry=geo_2, ClosestOnly=True)  # -> ClosestPoint, Distance, Index
lng = ListLength(List=pop3d)
random = Random(Range=dom, Number=lng, Seed=2)
addition = Addition(A=random, B=pull.Distance)
sort = SortList(Keys=addition, ValuesA=pop3d)  # -> Keys, ValuesA
not = GateNot(A=use_attractor)
panel = Panel("VORONOI FILL")
subset = SubList(List=sort.ValuesA, Domain=number_of_filtered_points, Wrap=True)  # -> List, Index
cull = CullPattern(List=pop3d, CullPattern=not)
cull_2 = CullPattern(List=subset.List, CullPattern=use_attractor)
pt = Point(flatten([cull_2, cull]))
minc = MeshInclusion(Mesh=mesh, Point=flatten(pt), Strict=False)
cull_3 = CullPattern(List=flatten(pt), CullPattern=minc)
cull_4 = CullPattern(List=cull_3, CullPattern=enable_voronoi)
voronoi³ = Voronoi3D(Points=flatten(cull_4), Box=bbox.Box)  # -> Cells, Boundary
edges = BrepEdges(Brep=voronoi³.Cells)  # -> Naked, Interior, NonManifold
mmx = MeshMesh(MeshA=mesh, MeshB=voronoi³.Cells)
explode = Explode(Curve=flatten(mmx), Recursive=True)  # -> Segments, flatten(Vertices)
remove_duplicate_lines = RemoveDuplicateLines(lattice_l=flatten(edges.Interior))
remove_duplicate_lines_2 = RemoveDuplicateLines(lattice_l=flatten(explode.Segments))
preview_points = ClusterOutput(cull_3)  # Preview of points that will create the voronoi lattice
voronoi_lattice_skin = ClusterOutput(remove_duplicate_lines_2)  # List of curves that make up the lattice skin
voronoi_lattice = ClusterOutput(remove_duplicate_lines)  # List of curves that make up the lattice

# ==== cluster RemoveDuplicateLines
lattice_l = ClusterInput()
crv = Curve(lattice_l)
curvepoint = PointOnCurve(crv, parameter=0.5)
cullpt = CullDuplicates(Points=curvepoint, Tolerance=".001", CullMode=1)  # -> Points, Indices, Valence
item = ListItem(List=crv, Index=cullpt.Indices, Wrap=True)
lattice = ClusterOutput(item)
