# Grasshopper definition unnamed.gh (Grasshopper 1.0.8)
# plug-ins: Flexibility

fingerdiam = Slider(17, range=0..30)
xy = XYPlane(Origin=Point(0, 0, 0))
expression = Expression(x=fingerdiam, Expression="x/2")
number_slider = Slider(15, range=10..25)
cir = Circle(Plane=xy, Radius=expression)
Z = UnitZ(Factor=number_slider)
len = Length(Curve=cir)
extr = Extrude(Base=cir, Direction=Z)
xz = XZPlane(Origin=Point(0, 0, 0))
neg = Negative(Value=Slider(0.5, range=0..10))
planesrf = PlaneSurface(Plane=xz, XSize=len, YSize=number_slider)
offset = OffsetCurve(Curve=planesrf, Distance=neg, Corners=1)
pop2d = Populate2D(Region=offset, Count=Slider(10, range=0..100), Seed=Slider(1, range=0..100))
voronoi = Voronoi(Points=pop2d, Boundary=offset, BruteForceOverride=False)
number_slider_2 = Slider(8, range=0..12)
offset_2 = OffsetCurve(Curve=voronoi, Distance=neg, Corners=1)
divide = DivideCurve(Curve=offset_2, Count=number_slider_2, Kinks=False)  # -> Points, Tangents, Parameters
expression_2 = Expression(x=number_slider_2, Expression="x-1")
nurbs = NurbsCurve(Vertices=divide.Points, Degree=expression_2, Periodic=invert(False))  # -> Curve, Length, Domain
boundary = BoundarySurfaces(Edges=flatten([nurbs.Curve, planesrf]), UseTasks=False)
planar = IsPlanar(Surface=boundary, Interior=True)  # -> Planar, Plane
amp = Amplitude(Vector=planar.Plane, Amplitude=Slider(2, range=0..10))
extr_2 = Extrude(Base=boundary, Direction=amp)
brep = Brep(extr_2)
sporph = FlowAlongSurface(
    Geometry=brep,
    Base=planesrf,
    UV1=null,
    Target=extr,
    UV2=null,
    FlipDirection=Slider(3, range=0..3),
    PreserveStructure=False,
    QuickPreview=False)  # -> reverse(Geometry)
rgb = ColourRGB(
    Alpha=Slider(255, range=0..255),
    Red=Slider(197, range=0..255),
    Green=Slider(0, range=0..255),
    Blue=Slider(198, range=0..255))
preview = CustomPreview(Geometry=sporph, Material=rgb)
