# Grasshopper definition Ex.1 - Line SDL + Blend curve.gh (Grasshopper 1.0.8)
# plug-ins: Pufferfish

X = UnitX(Factor=1)
pt = ConstructPoint(XCoordinate=0, YCoordinate=0, ZCoordinate=0)
Y = UnitY(Factor=1)
line = LineSDL(Start=pt, Direction=X, Length=Slider(36, range=0..100))
line_2 = LineSDL(Start=pt, Direction=Y, Length=Slider(156, range=0..1000))
X_2 = UnitX(Factor=Slider(522, range=0..1000))
move = Move(Geometry=line_2, Motion=X_2)  # -> Geometry, Transform
Z = UnitZ(Factor=Slider(202, range=0..1000))
move_2 = Move(Geometry=move.Geometry, Motion=Z)  # -> Geometry, Transform
move_3 = Move(Geometry=line, Motion=Z)  # -> Geometry, Transform
range = Range(Domain=Domain(0, 1), Steps=Slider(10, range=0..10))
tweencrv = TweenCurve(CurveA=line_2, CurveB=move_2.Geometry, Factor=range, BlendType=0)
mirror = MirrorCurve(Geometry=tweencrv, Curve=move_3.Geometry, Tangent=True)
item = ListItem(List=tweencrv, Index=Slider(11, range=0..100), Wrap=True)
item_2 = ListItem(List=tweencrv, Index=Slider(10, range=0..10), Wrap=True)
Y_2 = UnitY(Factor=Slider(61, range=0..100))
end = EndPoints(Curve=item)  # -> Start, End
end_2 = EndPoints(Curve=item_2)  # -> Start, End
rev = Reverse(Vector=Y_2)
move_4 = Move(Geometry=mirror, Motion=rev)  # -> Geometry, Transform
pt_2 = Point(end.End)
pt_3 = Point(end_2.End)
number_slider = Slider(0.52, range=0..1)
flip = FlipCurve(Curve=move_4.Geometry)  # -> Curve, Flag
blendc = BlendCurve(CurveA=flip.Curve, CurveB=tweencrv, BulgeA=number_slider, BulgeB=number_slider, Continuity=2)
number_slider_2 = Slider(10, range=0..10)
join = JoinCurves(Curves=[blendc, flip.Curve, tweencrv], Preserve=False)
item_3 = ListItem(List=flip.Curve, Index=Slider(11, range=0..100), Wrap=True)
cull_i = CullIndex(List=join, Indices=number_slider_2, Wrap=True)
item_4 = ListItem(List=join, Index=number_slider_2, Wrap=True)
item_5 = ListItem(List=flip.Curve, Index=Slider(10, range=0..10), Wrap=True)
end_3 = EndPoints(Curve=item_3)  # -> Start, End
end_4 = EndPoints(Curve=item_5)  # -> Start, End
X_3 = UnitX(Factor=Slider(48, range=0..100))
X_4 = UnitX(Factor=Slider(200, range=0..200))
extr = Extrude(Base=cull_i, Direction=X_3)
pt_4 = Point(end_3.Start)
pt_5 = Point(end_4.Start)
extr_2 = Extrude(Base=item_4, Direction=X_4)
debrep = DeconstructBrep(Brep=extr_2)  # -> Faces, Edges, Vertices
item_6 = ListItem(List=debrep.Vertices, Index=Slider(1, range=0..3), Wrap=True)
item_7 = ListItem(List=debrep.Vertices, Index=Slider(0, range=0..3), Wrap=True)
number_slider_3 = Slider(2, range=0..3)
item_8 = ListItem(List=debrep.Vertices, Index=Slider(2, range=0..3), Wrap=True)
item_9 = ListItem(List=debrep.Vertices, Index=Slider(3, range=0..3), Wrap=True)
neg = Negative(Value=Slider(52, range=0..100))
intcrv = Interpolate(Vertices=[pt_2, pt_3, item_9, item_8], Degree=3, Periodic=False, KnotStyle=1)  # -> Curve, Length, Domain
Z_2 = UnitZ(Factor=[neg, Slider(79, range=0..150)])
Z_3 = UnitZ(Factor=Slider(10, range=0..10))
neg_2 = Negative(Value=Slider(33, range=0..100))
move_5 = Move(Geometry=intcrv.Curve, Motion=Z_3)  # -> Geometry, Transform
extr_3 = Extrude(Base=move_5.Geometry, Direction=Z_2)
intcrv_2 = Interpolate(Vertices=[pt_4, pt_5, item_7, item_6], Degree=3, Periodic=False, KnotStyle=1)  # -> Curve, Length, Domain
Z_4 = UnitZ(Factor=[neg_2, Slider(69, range=0..150)])
Z_5 = UnitZ(Factor=Slider(20, range=0..30))
number_slider_4 = Slider(35, range=0..50)
number_slider_5 = Slider(10, range=0..20)
move_6 = Move(Geometry=intcrv_2.Curve, Motion=Z_5)  # -> Geometry, Transform
item_10 = ListItem(List=extr_3, Index=Slider(0, range=0..1), Wrap=True)
item_11 = ListItem(List=extr_3, Index=Slider(1, range=0..1), Wrap=True)
extr_4 = Extrude(Base=move_6.Geometry, Direction=Z_4)
expression = Expression(x=number_slider_4, Expression="x/2")
neg_3 = Negative(Value=number_slider_4)
item_12 = ListItem(List=extr_4, Index=Slider(0, range=0..1), Wrap=True)
item_13 = ListItem(List=extr_4, Index=Slider(1, range=0..1), Wrap=True)
offsrf = OffsetSurface(Surface=item_11, Distance=number_slider_5, BothSides=0, CreateSolid=True)
offsrf_2 = OffsetSurface(Surface=[extr, extr_2], Distance=Slider(15, range=0..20), BothSides=0, CreateSolid=True)
expression_2 = Expression(x=number_slider_4, Expression="x/2")
expression_3 = Expression(x=expression, y=number_slider_5, Expression="x-y/2")
offsrf_3 = OffsetSurface(Surface=item_10, Distance=neg_3, BothSides=0, CreateSolid=True)
Y_3 = UnitY(Factor=expression_3)
offsrf_4 = OffsetSurface(Surface=item_13, Distance=number_slider_5, BothSides=0, CreateSolid=True)
expression_4 = Expression(x=expression_2, y=number_slider_5, Expression="x+y/2")
move_7 = Move(Geometry=offsrf, Motion=Y_3)  # -> Geometry, Transform
neg_4 = Negative(Value=expression_4)
offsrf_5 = OffsetSurface(Surface=item_12, Distance=number_slider_4, BothSides=0, CreateSolid=True)
Y_4 = UnitY(Factor=neg_4)
move_8 = Move(Geometry=offsrf_4, Motion=Y_4)  # -> Geometry, Transform
preview = CustomPreview(
    Geometry=[offsrf_3, offsrf_5],
    Material={diffuse=RGB(255, 191, 0), emission=RGB(0, 0, 0), shine=1, specular=RGB(255, 255, 255), transparency=0})
preview_2 = CustomPreview(
    Geometry=offsrf_2,
    Material={diffuse=RGB(221, 160, 221), emission=RGB(66, 48, 66), shine=0.5, specular=RGB(255, 255, 255), transparency=0})
preview_3 = CustomPreview(
    Geometry=[move_8.Geometry, move_7.Geometry],
    Material={diffuse=RGB(0, 0, 0), emission=RGB(0, 0, 0), shine=1, specular=RGB(255, 255, 255), transparency=1})
