# Grasshopper definition Ex.2 - Graft + Attractor curve.gh (Grasshopper 1.0.8)
# plug-ins: Pufferfish, LunchBox

ellipse = Ellipse(Plane=PlaneXY(0, 0, 0), Radius1=Slider(3, range=0..10), Radius2=Slider(3, range=0..10))  # -> Ellipse, Focus1, Focus2
Z = UnitZ(Factor=Slider(3, range=0..10))
Z_2 = UnitZ(Factor=Slider(20, range=0..25))
move = Move(Geometry=ellipse.Ellipse, Motion=Z)  # -> Geometry, Transform
move_2 = Move(Geometry=ellipse.Ellipse, Motion=Z_2)  # -> Geometry, Transform
area = Area(Geometry=move.Geometry)  # -> Area, Centroid
rotate = Rotate(Geometry=move.Geometry, Angle=degrees(Slider(90, range=0..100)), Plane=PlaneXY(0, 0, 0))  # -> Geometry, Transform
scale = Scale(Geometry=rotate.Geometry, Center=area.Centroid, Factor=Slider(0.5, range=0..1))  # -> Geometry, Transform
crv = Curve(simplify(flatten(ellipse.Ellipse)))
crv_2 = Curve(simplify(flatten(scale.Geometry)))
crv_3 = Curve(simplify(flatten(move_2.Geometry)))
crv_4 = Curve(simplify(graft(crv_2)))
crv_5 = Curve(simplify(graft(crv_3)))
crv_6 = Curve(simplify(graft(crv)))
number_slider = Slider(11, range=0..100)
loft = Loft(
    Curves=[crv_6, crv_4, crv_5],
    Options={Adjust=False, Closed=False, LoftEnds=0, LoftSimp=0, LoftType=0, Rebuild=10, Refit=0.01})
boundary = BoundarySurfaces(Edges=crv_5)
subtraction = Subtraction(A=number_slider, B=Slider(1, range=0..1))
cir = Circle(Plane=PlaneXY(0, 0, 0), Radius=Slider(5, range=0..10))
range = Range(Domain=Domain(0, 1), Steps=subtraction)
divide = DivideCurve(Curve=cir, Count=number_slider, Kinks=False)  # -> Points, Tangents, Parameters
dom = ConstructDomain(DomainStart=Slider(8, range=0..100), DomainEnd=Slider(20, range=0..100))
graph = GraphMapper(
    range,
    x0=0,
    x1=1,
    y0=0,
    y1=1,
    container_name="Bezier",
    cpx=[0, 0.6342614293, 0.1190875545, 1],
    cpy=[0, 0.06345593929, 0.9347058535, 1])
bnd = Bounds(Numbers=graph)
remap = RemapNumbers(Value=dom, Source=bnd, Target=graph)  # -> Mapped, Clipped
Z_3 = UnitZ(Factor=remap.Mapped)
number_slider_2 = Slider(30, range=0..100)
move_3 = Move(Geometry=divide.Points, Motion=Z_3)  # -> Geometry, Transform
number_slider_3 = Slider(10, range=0..100)  # disabled
diamond = DiamondPanels(Surface=loft, UDivisions=number_slider_2, VDivisions=number_slider_2)  # -> DiamondPanels, TriPanels
intcrv = Interpolate(Vertices=move_3.Geometry, Degree=3, Periodic=False, KnotStyle=1)  # -> Curve, Length, Domain
dom_2 = ConstructDomain(DomainStart=Slider(0.2, range=0..1), DomainEnd=Slider(0.63, range=0..1))
area_2 = Area(Geometry=diamond.DiamondPanels)  # -> Area, Centroid
crv_cp = CurveClosestPoint(Point=area_2.Centroid, Curve=intcrv.Curve)  # -> Point, Parameter, Distance
bnd_2 = Bounds(Numbers=crv_cp.Distance)
remap_2 = RemapNumbers(Value=crv_cp.Distance, Source=bnd_2, Target=dom_2)  # -> Mapped, Clipped
frame = PanelFrame(Panel=[diamond.TriPanels, diamond.DiamondPanels], ScaleFactor=remap_2.Mapped)  # -> PanelFrame, Panel
mesh = MeshBrep(
    Brep=frame.PanelFrame,
    Settings={GridMaxCount=0, GridMinCount=16, JaggedSeams=False, MaxEdgeLength=0, MinEdgeLength=0.0001, MinTolerance=0, Refine=True, RefineAngle=0, RelativeTolerance=0.65, SimplePlanes=True, Tolerance=0})
flip = Flip(Surface=frame.Panel)  # -> Surface, Result
brep = Brep(frame.PanelFrame)
offmsh = OffsetMesh(Mesh=mesh, Distance=Slider(0.2, range=0..1), BothSides=0, CreateSolid=True)
preview = CustomPreview(
    Geometry=[brep, boundary],
    Material={diffuse=RGB(255, 163, 0), emission=RGB(0, 0, 0), shine=1, specular=RGB(255, 255, 255), transparency=0})
preview_2 = CustomPreview(
    Geometry=offmsh,
    Material={diffuse=RGB(191, 63, 255), emission=RGB(0, 0, 0), shine=1, specular=RGB(255, 255, 255), transparency=0})
preview_3 = CustomPreview(
    Geometry=flip.Surface,
    Material={diffuse=RGB(255, 163, 0), emission=RGB(0, 0, 0), shine=1, specular=RGB(255, 255, 255), transparency=0})
