# Grasshopper definition Ex.3 - Dispatch + Attractor point.gh (Grasshopper 1.0.8)
# plug-ins: Pufferfish, LunchBox

rectangle = Rectangle(Plane=PlaneXY(0, 0, 0), XSize=Slider(15, range=0..100), YSize=Slider(23, range=0..100), Radius=0)  # -> Rectangle, Length
unit_z = UnitZ(Factor=Slider(35, range=0..100))
extrude = Extrude(Base=rectangle.Rectangle, Direction=unit_z)
area = Area(Geometry=rectangle.Rectangle)  # -> Area, Centroid
deconstruct_brep = DeconstructBrep(Brep=extrude)  # -> Faces, Edges, Vertices
cap_holes = CapHoles(Brep=extrude)
deconstruct_brep_2 = DeconstructBrep(Brep=cap_holes)  # -> Faces, Edges, Vertices
list_item = ListItem(List=deconstruct_brep.Faces, Index=Slider(0, range=0..5), Wrap=True)
list_item_2 = ListItem(List=deconstruct_brep.Faces, Index=Slider(1, range=0..5), Wrap=True)
list_item_3 = ListItem(List=deconstruct_brep.Faces, Index=Slider(2, range=0..5), Wrap=True)
list_item_4 = ListItem(List=deconstruct_brep.Faces, Index=Slider(3, range=0..5), Wrap=True)
number_slider = Slider(20, range=0..100)
number_slider_2 = Slider(20, range=0..20)
list_item_5 = ListItem(List=deconstruct_brep_2.Faces, Index=Slider(4, range=0..5), Wrap=True)
quad_panels = QuadPanels(Surface=list_item_3, UDivisions=number_slider, VDivisions=number_slider_2)
quad_panels_2 = QuadPanels(Surface=list_item_2, UDivisions=number_slider, VDivisions=number_slider_2)
quad_panels_3 = QuadPanels(Surface=list_item_5, UDivisions=number_slider_2, VDivisions=number_slider)
offset_surface = OffsetSurface(Surface=quad_panels_3, Distance=Slider(1, range=0..5), BothSides=0, CreateSolid=True)

area_2 = Area(Geometry=quad_panels_2)  # -> Area, Centroid
list_item_6 = ListItem(List=area_2.Centroid, Index=Slider(28, range=0..100), Wrap=True)
distance = Distance(PointA=area_2.Centroid, PointB=list_item_6)
smaller_than = SmallerThan(FirstNumber=distance, SecondNumber=Slider(5.5, range=0..10))  # -> SmallerThan, OrEqualTo
dispatch = Dispatch(List=quad_panels_2, DispatchPattern=smaller_than.SmallerThan)  # -> ListA, ListB
brep = Brep(dispatch.ListB)
brep_2 = Brep(dispatch.ListA)
area_3 = Area(Geometry=brep_2)  # -> Area, Centroid
number_slider_3 = Slider(0, range=0..100)
distance_2 = Distance(PointA=area_3.Centroid, PointB=list_item_6)
offset_surface_2 = OffsetSurface(Surface=brep, Distance=Slider(1.5, range=0..10), BothSides=0, CreateSolid=True)
construct_domain = ConstructDomain(DomainStart=Slider(4, range=0..4.5), DomainEnd=Slider(0.6, range=0..5))
bounds = Bounds(Numbers=distance_2)
remap_numbers = RemapNumbers(Value=distance_2, Source=bounds, Target=construct_domain)  # -> Mapped, Clipped
unit_y = UnitY(Factor=remap_numbers.Mapped)
move = Move(Geometry=brep_2, Motion=unit_y)  # -> Geometry, Transform
panel_frame = PanelFrame(Panel=move.Geometry, ScaleFactor=Slider(0.95, range=0..1))  # -> PanelFrame, Panel
brep_3 = Brep(panel_frame.Panel)
negative = Negative(Value=Slider(2.21, range=0..10))
brep_4 = Brep(panel_frame.PanelFrame)
flip = Flip(Surface=brep_3)  # -> Surface, Result
offset_surface_3 = OffsetSurface(Surface=brep_4, Distance=negative, BothSides=0, CreateSolid=True)

area_4 = Area(Geometry=quad_panels)  # -> Area, Centroid
list_item_7 = ListItem(List=area_4.Centroid, Index=Slider(91, range=0..100), Wrap=True)
distance_3 = Distance(PointA=area_4.Centroid, PointB=list_item_7)
smaller_than_2 = SmallerThan(FirstNumber=distance_3, SecondNumber=Slider(5.5, range=0..10))  # -> SmallerThan, OrEqualTo
dispatch_2 = Dispatch(List=quad_panels, DispatchPattern=smaller_than_2.SmallerThan)  # -> ListA, ListB
brep_5 = Brep(dispatch_2.ListB)
brep_6 = Brep(dispatch_2.ListA)
area_5 = Area(Geometry=brep_6)  # -> Area, Centroid
number_slider_4 = Slider(0, range=0..100)
distance_4 = Distance(PointA=area_5.Centroid, PointB=list_item_7)
offset_surface_4 = OffsetSurface(Surface=brep_5, Distance=Slider(1.5, range=0..10), BothSides=0, CreateSolid=True)
construct_domain_2 = ConstructDomain(DomainStart=Slider(4, range=0..4.5), DomainEnd=Slider(0.6, range=0..5))
bounds_2 = Bounds(Numbers=distance_4)
remap_numbers_2 = RemapNumbers(Value=distance_4, Source=bounds_2, Target=construct_domain_2)  # -> Mapped, Clipped
unit_x = UnitX(Factor=remap_numbers_2.Mapped)
reverse = Reverse(Vector=unit_x)
move_2 = Move(Geometry=brep_6, Motion=reverse)  # -> Geometry, Transform
panel_frame_2 = PanelFrame(Panel=move_2.Geometry, ScaleFactor=Slider(0.95, range=0..1))  # -> PanelFrame, Panel
negative_2 = Negative(Value=Slider(2.21, range=0..10))
brep_7 = Brep(panel_frame_2.Panel)
brep_8 = Brep(panel_frame_2.PanelFrame)
flip_2 = Flip(Surface=brep_7)  # -> Surface, Result
offset_surface_5 = OffsetSurface(Surface=brep_8, Distance=negative_2, BothSides=0, CreateSolid=True)
number_slider_5 = Slider(180, range=0..1000)
rotate = Rotate(Geometry=offset_surface_3, Angle=degrees(number_slider_5), Plane=area.Centroid)  # -> Geometry, Transform
rotate_2 = Rotate(Geometry=offset_surface, Angle=degrees(number_slider_5), Plane=area.Centroid)  # -> Geometry, Transform
rotate_3 = Rotate(Geometry=[offset_surface_5, offset_surface_4], Angle=degrees(number_slider_5), Plane=area.Centroid)  # -> Geometry, Transform
custom_preview = CustomPreview(
    Geometry=[offset_surface_4, offset_surface_2, offset_surface],
    Material={diffuse=RGB(250, 250, 250), emission=RGB(0, 0, 0), shine=1, specular=RGB(255, 255, 255), transparency=0})
custom_preview_2 = CustomPreview(
    Geometry=[offset_surface_5, offset_surface_3, flip.Surface, flip_2.Surface],
    Material={diffuse=RGB(0, 127, 0), emission=RGB(0, 0, 0), shine=1, specular=RGB(255, 255, 255), transparency=0})
