# Grasshopper definition Ex.4 - Populate 3D + Voronoi 3D.gh (Grasshopper 1.0.8)
# plug-ins: Pufferfish, LunchBox

number_slider = Slider(50, range=0..100)
number_slider_2 = Slider(50, range=0..100)
number_slider_3 = Slider(50, range=0..100)
center_box = CenterBox(Base=PlaneXY(0, 0, 0), X=number_slider, Y=number_slider_2, Z=number_slider_3)
rectangle = Rectangle(Plane=PlaneXY(0, 0, 0), XSize=number_slider, YSize=number_slider_2, Radius=0)  # -> Rectangle, Length; disabled
unit_z = UnitZ(Factor=number_slider_3)
move = Move(Geometry=center_box, Motion=unit_z)  # -> Geometry, Transform
extrude = Extrude(Base=rectangle.Rectangle, Direction=unit_z)  # disabled
cap_holes = CapHoles(Brep=extrude)  # disabled
populate_3d = Populate3D(Region=move.Geometry, Count=Slider(100, range=0..100), Seed=Slider(1, range=0..1))
voronoi_3d = Voronoi3D(Points=populate_3d)  # -> Cells, Boundary
area = Area(Geometry=voronoi_3d.Cells)  # -> Area, Centroid
list_length = ListLength(List=voronoi_3d.Cells)
scale = Scale(Geometry=voronoi_3d.Cells, Center=area.Centroid, Factor=Slider(0.95, range=0..1))  # -> Geometry, Transform
split = Slider(0.5, range=0..1)
number_slider_4 = Slider(3, range=0..10)  # disabled
expression = Expression(x=list_length, Expression="x/2")
random_split_list = RandomSplitList(MasterList=scale.Geometry, Seed=expression, Split=split)  # -> ListA, ListB
number_slider_5 = Slider(0.3, range=0..1)
brep = Brep(random_split_list.ListB)
brep_2 = Brep(random_split_list.ListA)
number_slider_6 = Slider(3, range=0..10)
number_slider_7 = Slider(8, range=0..10)
deconstruct_brep = DeconstructBrep(Brep=brep)  # -> Faces, Edges, Vertices
list_item = ListItem(List=brep_2, Index=[number_slider_6, number_slider_7], Wrap=True)
cull_index = CullIndex(List=brep_2, Indices=[number_slider_6, number_slider_7], Wrap=True)
deconstruct_brep_2 = DeconstructBrep(Brep=list_item)  # -> Faces, Edges, Vertices
area_2 = Area(Geometry=list_item)  # -> Area, Centroid
panel_frame = PanelFrame(Panel=deconstruct_brep_2.Faces, ScaleFactor=Slider(0.8, range=0..1))  # -> PanelFrame, Panel
panel_frame_2 = PanelFrame(Panel=deconstruct_brep.Faces, ScaleFactor=Slider(0.95, range=0..1))  # -> PanelFrame, Panel
brep_3 = Brep(panel_frame.PanelFrame)
brep_4 = Brep(panel_frame.Panel)
brep_5 = Brep(panel_frame_2.Panel)
brep_6 = Brep(panel_frame_2.PanelFrame)
scale_2 = Scale(Geometry=list_item, Center=area_2.Centroid, Factor=Slider(0.9, range=0..1))  # -> Geometry, Transform
offset_surface = OffsetSurface(Surface=[brep_3, brep_6], Distance=Slider(0.6, range=0..1), BothSides=0, CreateSolid=True)
offset_surface_2 = OffsetSurface(Surface=brep_5, Distance=Slider(0.1, range=0..1), BothSides=0, CreateSolid=True)
custom_preview = CustomPreview(
    Geometry=[scale_2.Geometry, cull_index],
    Material={diffuse=RGB(0, 0, 0), emission=RGB(0, 0, 0), shine=0.85, specular=RGB(217, 207, 114), transparency=0})
custom_preview_2 = CustomPreview(
    Geometry=offset_surface,
    Material={diffuse=RGB(0, 0, 0), emission=RGB(0, 0, 0), shine=0.85, specular=RGB(212, 197, 146), transparency=0})
custom_preview_3 = CustomPreview(
    Geometry=offset_surface_2,
    Material={diffuse=RGB(0, 0, 0), emission=RGB(0, 0, 0), shine=0.85, specular=RGB(214, 132, 202), transparency=0})
