# Grasshopper definition Ex.5 - Voronoi 3D + Attractor Point.gh (Grasshopper 1.0.8)

number_slider = Slider(15, range=0..100)
number_slider_2 = Slider(15, range=0..100)
number_slider_3 = Slider(30, range=0..100)
rectangle = Rectangle(Plane=PlaneXY(0, 0, 0), XSize=number_slider_2, YSize=number_slider, Radius=0)  # -> Rectangle, Length
unit_z = UnitZ(Factor=number_slider_3)
extrude = Extrude(Base=rectangle.Rectangle, Direction=unit_z)
cap_holes = CapHoles(Brep=extrude)
number_slider_4 = Slider(0, range=0..10)
area = Area(Geometry=cap_holes)  # -> Area, Centroid
number_slider_5 = Slider(4, range=0..10)
number_slider_6 = Slider(0, range=0..10)
addition = Addition(A=number_slider, B=number_slider_4)
addition_2 = Addition(A=number_slider_2, B=number_slider_4)
addition_3 = Addition(A=number_slider_3, B=number_slider_4)
area_2 = Area(Geometry=extrude)  # -> Area, Centroid
populate_3d = Populate3D(Region=cap_holes, Count=Slider(300, range=0..1000), Seed=Slider(2, range=0..10))
unit_x = UnitX(Factor=Slider(20, range=0..100))
voronoi_3d = Voronoi3D(Points=populate_3d)  # -> Cells, Boundary
move = Move(Geometry=area_2.Centroid, Motion=unit_x)  # -> Geometry, Transform
construct_point = ConstructPoint(XCoordinate=addition_2, YCoordinate=addition, ZCoordinate=addition_3)
unit_z_2 = UnitZ(Factor=1)
move_2 = Move(Geometry=construct_point, Motion=Vector(0, 0, 10))  # -> Geometry, Transform
line_sdl = LineSDL(Start=move.Geometry, Direction=unit_z_2, Length=Slider(33, range=0..100))
volume = Volume(Geometry=voronoi_3d.Cells)  # -> Volume, Centroid
point_on_curve = PointOnCurve(line_sdl, parameter=0.679)
point = Point(<point referenced from the Rhino model>)
sphere = Sphere(Base=PlaneXY(0, 0, 0), Radius=1)
distance = Distance(PointA=volume.Centroid, PointB=point)
move_3 = Move(Geometry=sphere, Motion=point)  # -> Geometry, Transform
construct_domain = ConstructDomain(DomainStart=Slider(0.27, range=0.01..1), DomainEnd=Slider(1, range=0..1))
bounds = Bounds(Numbers=distance)
remap_numbers = RemapNumbers(Value=distance, Source=bounds, Target=construct_domain)  # -> Mapped, Clipped
scale = Scale(Geometry=cap_holes, Center=area.Centroid, Factor=Slider(0.9, range=0.01..1))  # -> Geometry, Transform
scale_2 = Scale(Geometry=voronoi_3d.Cells, Center=volume.Centroid, Factor=remap_numbers.Clipped)  # -> Geometry, Transform
custom_preview = CustomPreview(
    Geometry=scale.Geometry,
    Material={diffuse=RGB(250, 250, 250), emission=RGB(0, 0, 0), shine=1, specular=RGB(255, 255, 255), transparency=0})
custom_preview_2 = CustomPreview(
    Geometry=scale_2.Geometry,
    Material={diffuse=RGB(63, 191, 127), emission=RGB(0, 0, 0), shine=1, specular=RGB(255, 255, 255), transparency=0})
custom_preview_3 = CustomPreview(
    Geometry=move_3.Geometry,
    Material={diffuse=RGB(0, 0, 0), emission=RGB(0, 0, 0), shine=0.85, specular=RGB(206, 138, 98), transparency=0})
