# Grasshopper definition Below Knee - Template.ghx (Grasshopper 1.0.8)
# plug-ins: Pufferfish

# ---- group: Length limits
leg_diameter_minimum = Slider(60, range=40..100)
leg_knee_length_maximum = Slider(460, range=350..500)
leg_diameter_maximum = Slider(80, range=40..100)
# This script is dedicated for creating covers for below-knee prosthetic
leg_knee_length_minimum = Slider(350, range=350..500)

# ----
number_slider = Slider(0.25, range=0..1)
length_diameter = Slider(75.1, range=40..80)
length_knee = Slider(377.6, range=300..500)
construct_point = ConstructPoint(XCoordinate=0, YCoordinate=0, ZCoordinate=0)
unit_z = UnitZ(Factor=1)
expression = Expression(x=length_diameter, Expression="x/2")
line_sdl = LineSDL(Start=construct_point, Direction=unit_z, Length=length_knee)
xz_plane = XZPlane(Origin=Point(0, 0, 0))
unit_z_2 = UnitZ(Factor=length_knee)
plane_surface = PlaneSurface(Plane=PlaneXY(0, 0, 0), XSize=Domain(-10, 10), YSize=Domain(-10, 10))
number_slider_2 = Slider(79.06, range=0..500)
circle = Circle(Plane=PlaneXY(0, 0, 0), Radius=expression)
unit_z_3 = UnitZ(Factor=length_knee)
circle_2 = Circle(Plane=xz_plane, Radius=expression)
number_slider_3 = Slider(7, range=0..10)
number_slider_4 = Slider(137.57, range=0..500)
expression_2 = Expression(x=expression, Expression="-x")
move = Move(Geometry=circle, Motion=unit_z_2)  # -> Geometry, Transform
expression_3 = Expression(x=Slider(6, range=0..100), Expression="-x")
move_2 = Move(Geometry=plane_surface, Motion=unit_z_2)  # -> Geometry, Transform
move_3 = Move(Geometry=circle_2, Motion=unit_z_3)  # -> Geometry, Transform
expression_4 = Expression(x=Slider(55.5, range=0..100), Expression="-x")
expression_5 = Expression(x=number_slider_3, Expression="pow(x,-1)")
area = Area(Geometry=move_3.Geometry)  # -> Area, Centroid
addition = Addition(A=expression_2, B=expression_3)
addition_2 = Addition(A=number_slider_4, B=Slider(80.14, range=0..100))
addition_3 = Addition(A=expression_2, B=expression_4)
addition_4 = Addition(A=number_slider_2, B=Slider(114.26, range=0..200))
addition_5 = Addition(A=expression, B=Slider(54.12, range=0..100))
series = Series(Start=0, Step=expression_5, Count=number_slider_3)
construct_point_2 = ConstructPoint(XCoordinate=addition, YCoordinate=0, ZCoordinate=number_slider_4)
construct_point_3 = ConstructPoint(XCoordinate=expression_2, YCoordinate=0, ZCoordinate=0)
construct_point_4 = ConstructPoint(XCoordinate=expression, YCoordinate=0, ZCoordinate=0)
construct_point_5 = ConstructPoint(XCoordinate=addition_3, YCoordinate=0, ZCoordinate=addition_2)
construct_point_6 = ConstructPoint(XCoordinate=expression, YCoordinate=0, ZCoordinate=number_slider_2)
construct_point_7 = ConstructPoint(XCoordinate=addition_5, YCoordinate=0, ZCoordinate=addition_4)
tween_curve = TweenCurve(CurveA=circle, CurveB=move.Geometry, Factor=series, BlendType=0)
scale = Scale(Geometry=move_3.Geometry, Center=area.Centroid, Factor=Slider(1.55, range=0..2))  # -> Geometry, Transform
area_2 = Area(Geometry=scale.Geometry)  # -> Area, Centroid
unit_x = UnitX(Factor=1)
evaluate_curve = EvaluateCurve(Curve=reparameterize(scale.Geometry), Parameter=Slider(0, range=0..1))  # -> Point, Tangent, Angle
evaluate_curve_2 = EvaluateCurve(Curve=reparameterize(scale.Geometry), Parameter=Slider(0.5, range=0..1))  # -> Point, Tangent, Angle
area_3 = Area(Geometry=circle_2)  # -> Area, Centroid
unit_x_2 = UnitX(Factor=1)
point = Point(evaluate_curve.Point)
point_2 = Point(evaluate_curve_2.Point)
rotate_3d = Rotate3D(Geometry=scale.Geometry, Angle=1.570796327, Center=area_2.Centroid, Axis=unit_x)  # -> Geometry, Transform
rotate_3d_2 = Rotate3D(Geometry=circle_2, Angle=1.570796327, Center=area_3.Centroid, Axis=unit_x_2)  # -> Geometry, Transform
merge = Merge(Data1=construct_point_4, Data2=construct_point_6, Data3=construct_point_7, Data4=point)
merge_2 = Merge(Data1=construct_point_3, Data2=construct_point_2, Data3=construct_point_5, Data4=point_2)
nurbs_curve = NurbsCurve(Vertices=merge_2, Degree=3, Periodic=False)  # -> Curve, Length, Domain
nurbs_curve_2 = NurbsCurve(Vertices=merge, Degree=3, Periodic=False)  # -> Curve, Length, Domain
sweep2 = Sweep2(
    Rail1=nurbs_curve.Curve,
    Rail2=nurbs_curve_2.Curve,
    Sections=[rotate_3d_2.Geometry, rotate_3d.Geometry],
    SameHeight=False)
cap_holes = CapHoles(Brep=sweep2)
deconstruct_brep = DeconstructBrep(Brep=cap_holes)  # -> Faces, Edges, Vertices
panel = Panel("""1
2""")
list_item = ListItem(List=deconstruct_brep.Faces, Index=panel, Wrap=True)
shell_polysurface = ShellPolysurface(Polysurface=cap_holes, Removal=panel, Thickness=Slider(3, range=0..5), FaceMerge=False)
