# Grasshopper definition unnamed.gh (Grasshopper 1.0.8)
# plug-ins: Parakeet, Weaverbird, Flexibility

number_slider = Slider(3, range=0..10)
addition = Addition(A=number_slider, B=Slider(2, range=0..10))
construct_point = ConstructPoint(XCoordinate=0, YCoordinate=0, ZCoordinate=0)
width = Slider(10, range=0..10)
construct_point_2 = ConstructPoint(XCoordinate=number_slider, YCoordinate=0, ZCoordinate=0)
offset = Slider(1.9, range=0..3)
xz_plane = XZPlane(Origin=Point(0, 0, 0))
construct_point_3 = ConstructPoint(XCoordinate=number_slider, YCoordinate=0, ZCoordinate=Slider(2, range=0..10))
unit_x = UnitX(Factor=addition)
yz_plane = YZPlane(Origin=Point(0, 0, 0))
rectangle = Rectangle(Plane=xz_plane, XSize=width, YSize=offset, Radius=0)  # -> Rectangle, Length
move = Move(Geometry=yz_plane, Motion=unit_x)  # -> Geometry, Transform
mirror = Mirror(Geometry=[construct_point, construct_point_2, construct_point_3], Plane=move.Geometry)  # -> Geometry, Transform
merge = Merge(Data1=construct_point, Data2=construct_point_2, Data3=construct_point_3)
unit_x_2 = UnitX(Factor=Slider(82, range=0..100))
curve = Curve(rectangle.Rectangle)
reverse_list = ReverseList(List=mirror.Geometry)
number_slider_2 = Slider(2, range=0..100)
point_list = PointList(Points=merge, Size=number_slider_2)
list_item = ListItem(List=mirror.Geometry, Index=0, Wrap=True)
move_2 = Move(Geometry=curve, Motion=unit_x_2)  # -> Geometry, Transform
number = Number(width)
merge_2 = Merge(Data1=merge, Data2=reverse_list)
point = Point(construct_point)
distance = Distance(PointA=construct_point, PointB=list_item)
unit_y = UnitY(Factor=Slider(200, range=0..1000))
sort_list = SortList(Keys=merge_2, ValuesValuesA=merge_2)  # -> Keys, ValuesValuesA
point_list_2 = PointList(Points=mirror.Geometry, Size=number_slider_2)
number_slider_3 = Slider(329, range=0..400)
vector_xyz = VectorXYZ(XComponent=Slider(101, range=0..1000), YComponent=0, ZComponent=0)  # -> Vector, Length
polyline = PolyLine(Vertices=merge_2, Closed=False)
point_list_3 = PointList(Points=sort_list.ValuesValuesA, Size=number_slider_2)
extrude = Extrude(Base=move_2.Geometry, Direction=unit_y)
addition_2 = Addition(A=number, B=Slider(2.4, range=0..10))
unit_y_2 = UnitY(Factor=number_slider_3)
move_3 = Move(Geometry=[polyline, point], Motion=vector_xyz.Vector)  # -> Geometry, Transform
cap_holes = CapHoles(Brep=extrude)
cull_index = CullIndex(List=move_3.Geometry, Indices=1, Wrap=True)
unit_x_3 = UnitX(Factor=addition_2)
list_item_2 = ListItem(List=move_3.Geometry, Index=expr("1", 0), Wrap=True)
createsolid = CreateSolid(Breps=cap_holes)
unit_x_4 = UnitX(Factor=distance)
extrude_2 = Extrude(Base=cull_index, Direction=unit_y_2)
construct_plane = ConstructPlane(Origin=list_item_2, XAxis=Vector(1, 0, 0), YAxis=Vector(0, 1, 0))
linear_array = LinearArray(Geometry=createsolid, Direction=unit_x_3, Count=Slider(40, range=0..100))  # -> Geometry, Transform
number_slider_4 = Slider(40, range=0..100)
multiplication = Multiplication(A=number_slider_4, B=distance)
brep = Brep(<brep referenced from the Rhino model>)
vector_xyz_2 = VectorXYZ(XComponent=multiplication, YComponent=number_slider_3, ZComponent=0)  # -> Vector, Length
move_4 = Move(Geometry=list_item_2, Motion=vector_xyz_2.Vector)  # -> Geometry, Transform
rectangle_2pt = Rectangle2Pt(Plane=list_item_2, PointA=list_item_2, PointB=move_4.Geometry, Radius=0)  # -> Rectangle, Length
linear_array_2 = LinearArray(Geometry=extrude_2, Direction=unit_x_4, Count=number_slider_4)  # -> Geometry, Transform
deconstruct_brep = DeconstructBrep(Brep=brep)  # -> Faces, Edges, Vertices
group = Group(Geometry=linear_array.Geometry)
surface = Surface(rectangle_2pt.Rectangle)
unit_z = UnitZ(Factor=Slider(1, range=0..10))
brep_join = BrepJoin(Breps=linear_array_2.Geometry)  # -> Breps, Closed
list_item_3 = ListItem(List=deconstruct_brep.Faces, Index=Slider(4, range=0..10), Wrap=True)
bounding_box = BoundingBox(Content=group, Plane=PlaneXY(0, 0, 0))  # -> Box, Box_2
surface_2 = Surface(list_item_3)
transpose_surface = TransposeSurface(Surface=surface_2)  # -> Surface, U, V
explode_object = ExplodeObject(Object=bounding_box.Box, Recursive=False)
list_item_4 = ListItem(List=explode_object, Index=4, Wrap=True)
move_5 = Move(Geometry=list_item_4, Motion=unit_z)  # -> Geometry, Transform
reverse_surface = ReverseSurface(Surface=list_item_4, U=False, V=True, W=False, ShowArrows=True)
sporph = Sporph(Geometry=linear_array.Geometry, Base=move_5.Geometry, Target=transpose_surface.Surface, Rigid=False)
brep_join_2 = BrepJoin(Breps=flatten([sporph, brep]))  # -> Breps, Closed
colour_swatch = ColourSwatch(SwatchColor=RGB(153, 150, 150))
shrinkwrap = ShrinkWrap(
    Geometry=brep_join_2.Breps,
    EdgeLength=Slider(0.1, range=0..100),
    Offset=0,
    Smoothing=0,
    Optimization=Slider(10, range=0..100),
    FillHoles=True)
weaverbird_s_laplacian_smoothing = WeaverbirdsLaplacianSmoothing(MeshCurves=shrinkwrap, Level=Slider(3, range=0..3), SmoothNakedEdges=1, Thin=1)  # disabled
reduce_mesh = ReduceMesh(
    Mesh=weaverbird_s_laplacian_smoothing,
    PolygonCount=30,
    Distortion=True,
    Accuracy=8,
    Normalize=True,
    Unweld=True,
    Explode=False,
    Angle=12)  # disabled
colour_swatch_2 = ColourSwatch(SwatchColor=RGB(43, 79, 43))  # disabled
custom_preview = CustomPreview(Geometry=weaverbird_s_laplacian_smoothing, Material=colour_swatch_2)  # disabled
